# Grasshopper definition GangGang-example.ghx (Grasshopper 0.9.76)
# plug-ins: Python Interpreter

series = Series(Start=0, Step=1, Count=Slider(54, range=0..100))
data = Data(series)
dam = DataDam(DataA=data, BufferDelay=20000000, BufferMode=2)
ganggang_send = PythonScript(Activate=Toggle(False), Host="0.tcp.ngrok.io", Port="18137", Data=dam)  # -> out, Result, dump; inputs Port: Int32, Data: list
# ---------- ganggang_send: Python ----------
import socket
import pickle




if (Activate):
    
    dump = pickle.dumps(Data, 0)

    clientsocket = socket.socket(socket.AF_INET, socket.SOCK_STREAM)
    try:
        clientsocket.connect((Host, Port))
    except Exception, e:
        print e
    clientsocket.send(dump)
    
    data = ""
    data = clientsocket.recv(1024)
    print 'Received', repr(data)
    Result = data
    clientsocket.close()
# ---------- end ganggang_send ----------
ma = MassAddition(Input=dam)  # -> Result, PartialResults
panel = Panel(ganggang_send.Result)
panel_2 = Panel(ma.Result)
