# Grasshopper definition gh_PYRO_client_test__not_working.ghx (Grasshopper 0.9.76)
# plug-ins: Python Interpreter

python = PythonScript()  # -> out, a; disabled
# ---------- python: Python ----------
import sys

def append_path_once(my_path):
    if my_path not in sys.path:
        sys.path.append(my_path)

for p in sys.path:
    print ">>>", p
import platform

def new_python_implementation():
    return "IronPython"

temp_impl = platform.python_implementation
platform.python_implementation = new_python_implementation
print platform.python_implementation()

import Pyro4

platform.python_implementation = temp_impl
# ---------- end python ----------
python_2 = PythonScript()  # -> out, a
# ---------- python_2: Python ----------
import sys

for f in sys.path:
    print ">>>", f

#### PYRO4 IMPORT WORKAROUND

import platform
def new_python_implementation():
    return "IronPython"
temp_impl = platform.python_implementation
platform.python_implementation = new_python_implementation
import Pyro4
platform.python_implementation = temp_impl

######################################

import serpent

uri = "example.greeting"
name = "bumpy"

Pyro4.config.HOST = "172.16.15.1"

#ns = Pyro4.locateNS(host="0.tcp.ngrok.io", port=12771)
ns = Pyro4.locateNS(host="172.16.15.1")

print ns



#uri = ns.lookup(uri)

uri = "PYRO:obj_5e07f6b6ab99486180cec8f8902b6878@172.16.15.1:58348"

greeting_maker = Pyro4.Proxy(uri)         # get a Pyro proxy to the greeting object
print(greeting_maker.get_fortune(name))   # call method normally


print( greeting_maker.get_numpy_mean(range(100)) )  # call method normally
print( greeting_maker.get_numpy_mean(range(1000)) )   # call method normally
# ---------- end python_2 ----------
